# Dynamo graph sheets&levels -on y va(right one ).dyn "sheets&levels -on y va" (Dynamo 2.17.0.3472)
# packages: archi-lab.net 2024.217.1024

# group: USER INPUT
file_path = Filename("D:\iti\Dynamo\Levels And Elevations.xlsx")

file_from_path = FileObject(path=file_path)
string = StringInput("Levels")

# group: CREATING LEVELS
importExcel = Data.ImportExcel(file=file_from_path, sheetName=string)
transpose = List.Transpose(lists=importExcel)
code_block = CodeBlock(LST=transpose) { LST[0]; LST[1]; }
restOfItems = List.RestOfItems(list=code_block.out1)
restOfItems_2 = List.RestOfItems(list=code_block.out0)
byElevationAndName = Level.ByElevationAndName(elevation=restOfItems, name=restOfItems_2)

name = Level.Name(level=byElevationAndName)
categories = Categories("OST_Views")
all_elements_of_category = ElementsOfCategory(Category=categories)
file_from_path_2 = FileObject(path=file_path)
string_2 = StringInput("Sheets")
importExcel_2 = Data.ImportExcel(file=file_from_path_2, sheetName=string_2)
transpose_2 = List.Transpose(lists=importExcel_2)
code_block_2 = CodeBlock(LST=transpose_2)
# ---------- code_block_2.designscript (4 lines) ----------
//sheet numbers, sheetnames, view names;
LST[0];
LST[1];
LST[2];
# ----------------------------------------
restOfItems_3 = List.RestOfItems(list=code_block_2.out1)
restOfItems_4 = List.RestOfItems(list=code_block_2.out0)
family_types = FamilyTypes("A0 metric:A0 metric")
count = List.Count(list=restOfItems_3)
cycle = List.Cycle(list=family_types, amount=count)
file_from_path_3 = FileObject(path=file_path)
string_3 = StringInput("Floor Plans")

# group: creating floor plans
importExcel_3 = Data.ImportExcel(file=file_from_path_3, sheetName=string_3)
transpose_3 = List.Transpose(lists=importExcel_3)
code_block_3 = CodeBlock(LST=transpose_3)
# ---------- code_block_3.designscript (3 lines) ----------
//VIEW NAMES AND LEVEL NAMES;
LST[0];
LST[1];
# ----------------------------------------
restOfItems_5 = List.RestOfItems(list=code_block_3.out1)
indexOf = List.IndexOf(list=restOfItems_2, element=restOfItems_5)
getItemAtIndex = List.GetItemAtIndex(list=byElevationAndName, index=indexOf)
byLevel = FloorPlanView.ByLevel(level=getItemAtIndex)
code_block_4 = CodeBlock { "View Name"; }
restOfItems_6 = List.RestOfItems(list=code_block_3.out0)
setParameterByName = Element.SetParameterByName(element=byLevel, parameterName=code_block_4, value=restOfItems_6)

file_from_path_4 = FileObject(path=file_path)
string_4 = StringInput("Reflected Ceiling Plans")

# group: creating ceiling plans
importExcel_4 = Data.ImportExcel(file=file_from_path_4, sheetName=string_4)
transpose_4 = List.Transpose(lists=importExcel_4)
code_block_5 = CodeBlock(LST=transpose_4)  # same code as code_block_3
restOfItems_7 = List.RestOfItems(list=code_block_5.out1)
indexOf_2 = List.IndexOf(list=restOfItems_2, element=restOfItems_7)
getItemAtIndex_2 = List.GetItemAtIndex(list=byElevationAndName, index=indexOf_2)
code_block_6 = CodeBlock { "View Name"; }
restOfItems_8 = List.RestOfItems(list=code_block_5.out0)

byLevel_2 = CeilingPlanView.ByLevel(level=getItemAtIndex_2)

# group (continued): creating ceiling plans
setParameterByName_2 = Element.SetParameterByName(element=byLevel_2, parameterName=code_block_6, value=restOfItems_8)

join = List.Join(list0=setParameterByName, list1=setParameterByName_2)
name_2 = Element.Name(element=join)
restOfItems_9 = List.RestOfItems(list=code_block_2.out2)
indexOf_3 = List.IndexOf(list=name_2, element=restOfItems_9)
getItemAtIndex_3 = List.GetItemAtIndex(list=join, index=indexOf_3)
views = Views("iti")
isNull = Object.IsNull()  # unwired: object
replaceByCondition = Replace(item=getItemAtIndex_3, replaceWith=views, condition=isNull)
byNameNumberTitleBlockAndView = Sheet.ByNameNumberTitleBlockAndView(sheetName=restOfItems_3, sheetNumber=restOfItems_4, titleBlockFamilyType=cycle, view=replaceByCondition)

# group: changing the position of view port in sheet
viewports = Sheet.Viewports(sheet=byNameNumberTitleBlockAndView)
boxCenter = Viewport.BoxCenter(viewport=viewports)
code_block_7 = CodeBlock { 594; }
code_block_8 = CodeBlock { 420; }
translate = Geometry.Translate(geometry=boxCenter, xTranslation=code_block_7, yTranslation=code_block_8)
count_2 = List.Count(list=viewports)
cycle_2 = List.Cycle(list=translate, amount=count_2)
setBoxCenter = archilab.Revit.Views.Viewports.SetBoxCenter(viewport=viewports@L2, point=cycle_2, lacing=Longest)

# group: GETTING VIEWS
element_classes = ElementTypes("ViewPlan")  # frozen
all_elements_of_class = ElementsOfType(element_type=element_classes)
code_block_9 = CodeBlock { "View Name"; }
getParameterValueByName = Element.GetParameterValueByName(element=all_elements_of_class, parameterName=code_block_9)
code_block_10 = CodeBlock(x=getParameterValueByName) { x!=""; }
code_block_11 = CodeBlock(x=getParameterValueByName) { x!="Site"; }
and_ = code_block_10 && code_block_11
NAMES = List.FilterByBoolMask(list=getParameterValueByName, mask=and_)
views_2 = List.FilterByBoolMask(list=all_elements_of_class, mask=and_)

# group: NUMBERING SHEETS
code_block_12 = CodeBlock { "R"; }
code_block_13 = CodeBlock { 800; }
count_3 = List.Count(list=NAMES.in)
code_block_14 = CodeBlock(X=count_3) { 800+X; }
range = Range(start=code_block_13, end=code_block_14)
add = code_block_12 + range
string_from_object = FromObject(obj=add)

# group: TITLE BLOCK
family_types_2 = FamilyTypes("A0 metric:A0 metric")
cycle_3 = List.Cycle(list=family_types_2, amount=count_3)

byNameNumberTitleBlockAndView_2 = Sheet.ByNameNumberTitleBlockAndView(sheetName=NAMES.in, sheetNumber=string_from_object, titleBlockFamilyType=cycle_3, view=views_2.in)
viewports_2 = archilab.Revit.Views.Sheets.Viewports(sheet=byNameNumberTitleBlockAndView_2)

# group: عبث
boundingBox = Element.BoundingBox(element=viewports_2)
maxPoint = BoundingBox.MaxPoint(boundingBox=boundingBox)
Z = Point.Z(point=maxPoint)
X = Point.X(point=maxPoint)
minPoint = BoundingBox.MinPoint(boundingBox=boundingBox)
X_2 = Point.X(point=minPoint)
code_block_15 = CodeBlock(x1=X, x2=X_2) { (x1+x2)/2; }
Y = Point.Y(point=maxPoint)
Y_2 = Point.Y(point=minPoint)
code_block_16 = CodeBlock(x1=Y, x2=Y_2) { (x1+x2)/2; }
Z_2 = Point.Z(point=minPoint)
code_block_17 = CodeBlock(x1=Z_2, x2=Y_2) { (x1+x2)/2; }
byCoordinates = Point.ByCoordinates(x=code_block_15, y=code_block_16, z=code_block_17)
code_block_18 = CodeBlock { (x1+x2)/2; }  # unwired: x1, x2
